# Grasshopper definition joint_connector_generalized.gh (Grasshopper 1.0.7)
# plug-ins: EleFront, Weaverbird, Kangaroo2 Components, DendroGH

python = GhPythonScript()  # -> out, cd
# ---------- python: Python ----------
path = ghenv.Component.OnPingDocument().FilePath

separator = '/'
split = path.split(separator)
print split

if len(split) < 2:
    separator = '\\'
    split = path.split(separator)

cd = separator.join(split[:-3]) + separator + "mesh" + separator
# ---------- end python ----------
python_2 = GhPythonScript()  # -> out, cd
# ---------- python_2: Python ----------
__author__ = "ytakzk"
__version__ = "2018.12.04"

path = ghenv.Component.OnPingDocument().FilePath

separator = '/'
split = path.split(separator)
print split

if len(split) < 2:
    separator = '\\'
    split = path.split(separator)

cd = separator.join(split[:-1]) + separator
# ---------- end python_2 ----------
panel = Panel(python_2.cd)
panel_2 = Panel(python.cd)
python_script = PythonScript(cd=python.cd)  # -> out, vertices, faces
# ---------- python_script: Python ----------
import Rhino.Geometry as rg
file = open(cd + 'mesh.obj')
lines = file.readlines()
vertices=[]
faces=[]
for line in lines:
    if line.find("v")==0 and line.find("n")==-1 and line.find("t")==-1:
        print line.split(' ')
        vertices.Add(rg.Point3d(float((line.split(' '))[1]),float((line.split(' '))[2]),float((line.split(' '))[3])))
    if line.find("f")==0:
        if line.split(' ').Count==4:
            faces.Add(rg.MeshFace(int(line.split(' ')[1].split('/')[0])-1,int(line.split(' ')[2].split('/')[0])-1,int(line.split(' ')[3].split('/')[0])-1))
        if line.split(' ').Count==5:
            faces.Add(rg.MeshFace(int(line.split(' ')[1].split('/')[0])-1,int(line.split(' ')[2].split('/')[0])-1,int(line.split(' ')[3].split('/')[0])-1,int(line.split(' ')[4].split('/')[0])-1))
# ---------- end python_script ----------
construct_mesh = ConstructMesh(Vertices=python_script.vertices, Faces=python_script.faces)
mesh = Mesh(construct_mesh)

# ---- group: debug
node_index = Slider(0, range=0..100)
python_3 = GhPythonScript(m=mesh, x=node_index)  # -> out, pairs, vertices; inputs m: Mesh, x: Int32
# ---------- python_3: Python ----------
__author__ = "ytakzk"
__version__ = "2018.12.06"

import Rhino.Geometry as rg
import clr
clr.AddReference("Grasshopper")
import Grasshopper.Kernel.Data.GH_Path as ghpath
import Grasshopper.DataTree as datatree
import System

pairs = datatree[System.Object]()
vertices = datatree[System.Object]()

if x == "None":
    print " no vertex index given"
    x = 0

for i, v in enumerate(m.TopologyVertices, x):
    print i
    induces = m.TopologyVertices.ConnectedTopologyVertices(i)

    path = ghpath(i)

    for v in induces:
        vertex = m.TopologyVertices[v]
        pairs.Add(vertex, path)
    
    vertices.Add(m.TopologyVertices[i], path)
    
    if i == x+5:
        break
# ---------- end python_3 ----------

# ----
connection_tolerance_rod_to_joint = Slider(0.2, range=0.01..1)
depth_of_the_rods_in_the_joints = Slider(5, range=0..10)
joint_outer_radius_sphere = Slider(17, range=0..100)
rod_radius_cylinder = Slider(2, range=0.01..10)

python_4 = GhPythonScript(m=mesh)  # -> out, pairs, vertices; inputs m: Mesh
# ---------- python_4: Python ----------
__author__ = "ytakzk"
__version__ = "2018.12.06"

import Rhino.Geometry as rg
import clr
clr.AddReference("Grasshopper")
import Grasshopper.Kernel.Data.GH_Path as ghpath
import Grasshopper.DataTree as datatree
import System

pairs = datatree[System.Object]()
vertices = datatree[System.Object]()

for i, v in enumerate(m.TopologyVertices):
    
    induces = m.TopologyVertices.ConnectedTopologyVertices(i)

    path = ghpath(i)

    for v in induces:
        vertex = m.TopologyVertices[v]
        pairs.Add(vertex, path)
    
    vertices.Add(m.TopologyVertices[i], path)
# ---------- end python_4 ----------

# ---- group: size of the table
bbox = BoundingBox(Content=mesh, Plane=PlaneXY(0, 0, 0))  # -> Box, Box_2
debox = DeconstructBox(Box=bbox.Box)  # -> Plane, X, Y, Z
dedomain = DeconstructDomain(Domain=[debox.X, debox.Y, debox.Z])  # -> Start, End
subtraction = Subtraction(A=dedomain.End, B=dedomain.Start)
panel_3 = Panel(subtraction)

# ---- group: rods
medges = MeshEdges(Mesh=mesh)  # -> NakedEdges, InteriorEdges, NonManifoldEdges
merge = Merge(Data1=medges.NakedEdges, Data2=medges.InteriorEdges, Data3=medges.NonManifoldEdges)
pipe = Pipe(Curve=merge, Radius=rod_radius_cylinder, Caps=0)
cap = CapHoles(Brep=pipe)

# ----
ln = Line(StartPoint=python_3.pairs, EndPoint=python_3.vertices)
sph = Sphere(Base=python_3.vertices, Radius=joint_outer_radius_sphere)
crv = Curve(ln)
srf = Surface(sph)
len = Length(Curve=merge)
ma = MassAddition(Input=len)  # -> Result, PartialResults
scx = SurfaceCurve(Surface=srf, Curve=crv)  # -> Curves, Points, UVPoints, Normals, Parameters, Tangents
bar_graph = BarGraph(len, BarColor=RGB(255, 0, 90))
pshift = ShiftPaths(Data=scx.Points, Offset=-1)
pshift_2 = ShiftPaths(Data=scx.Normals, Offset=-1)
dist = Distance(PointA=pshift, PointB=python_3.vertices)
division = Division(A=dist, B=Slider(2, range=0..10))
item = ListItem(List=division, Index=0, Wrap=True)
sph_2 = Sphere(Base=python_3.vertices, Radius=item)
shift = ShiftList(List=pshift, Shift=1, Wrap=True)
srf_2 = Surface(sph_2)
geodesic = Geodesic(Surface=srf, Start=pshift, End=shift)
subtraction_2 = Subtraction(A=dist, B=division)
line = LineSDL(Start=pshift, Direction=pshift_2, Length=expr("x/3", division))
planar = Planar(Curve=geodesic)  # -> Planar, Plane, Deviation

# ---- group: vizualization of the cuting planes
ln_2 = Line(StartPoint=pshift, EndPoint=shift)
eval = EvaluateCurve(Curve=reparameterize(ln_2), Parameter=0.5)  # -> Point, Tangent, Angle
pl_origin = PlaneOrigin(Base=planar.Plane, Origin=eval.Point)

# ----
line_2 = LineSDL(Start=pshift, Direction=expr("x*-1", pshift_2), Length=subtraction_2)
line_3 = LineSDL(Start=pshift, Direction=expr("x*-1", pshift_2), Length=depth_of_the_rods_in_the_joints)
sec = BrepPlane(Brep=srf_2, Plane=simplify(planar.Plane))  # -> Curves, Points
panel_4 = Panel(line_3)
sec_2 = BrepPlane(Brep=srf, Plane=simplify(planar.Plane))  # -> Curves, Points

outter_stripe_width = Slider(3.7, range=2..10)
inner_stripe_width = Slider(2.5, range=2..10)
rod_holder_outer_radius_cylinder = Slider(3.5, range=0..10)

tapering_of_inner_hole = Slider(0.462, range=0..1)
vsettings = CreateSettings(VoxelSize=Slider(0.2, range=0..1), Bandwidth=1, Isovalue=0.002, Adaptivity=0.1)
position_of_the_screw_holes = Slider(0.75, range=0..1)
addition = Addition(A=rod_radius_cylinder, B=connection_tolerance_rod_to_joint)
addition_2 = Addition(A=addition, B=tapering_of_inner_hole)
dom = ConstructDomain(DomainStart=addition, DomainEnd=addition_2)
number_slider = Slider(10, range=0..10)
range = Range(Domain=dom, Steps=number_slider)
geo = Geometry(line_3)
eval_2 = EvaluateCurve(Curve=line_3, Parameter=position_of_the_screw_holes)  # -> Point, Tangent, Angle
lng = ListLength(List=range)
lng_2 = ListLength(List=line_3)
divide = DivideCurve(Curve=line_3, Count=number_slider, Kinks=False)  # -> Points, Tangents, Parameters
pshift_3 = ShiftPaths(Data=sec.Curves, Offset=-1)
item_2 = ListItem(List=division, Index=0, Wrap=True)
pshift_4 = ShiftPaths(Data=sec_2.Curves, Offset=-1)
pl = PlaneNormal(Origin=eval_2.Point, ZAxis=eval_2.Tangent)
multiplication = Multiplication(A=lng, B=lng_2)  # -> simplify(Result)
repeat = RepeatData(Data=range, Length=multiplication)
labeling_pattern_multiplication = Slider(1, range=0..10)
pshift_5 = ShiftPaths(Data=repeat, Offset=-1)  # -> simplify(Data)
pshift_6 = ShiftPaths(Data=divide.Points, Offset=-1)
deplane = DeconstructPlane(Plane=pl)  # -> Origin, unitize(XAxis), unitize(YAxis), unitize(ZAxis)
popgeo = PopulateGeometry(Geometry=srf, Count=1, Seed=1, Points=pshift)
vcurve = CurveToVolume(Curves=pshift_4, CurveRadius=expr("x/5", outter_stripe_width), Settings=vsettings)
vcurve_2 = CurveToVolume(Curves=pshift_4, CurveRadius=expr("x/2", outter_stripe_width), Settings=vsettings)
vcurve_3 = CurveToVolume(Curves=pshift_3, CurveRadius=expr("x/2", inner_stripe_width), Settings=vsettings)
item_3 = ListItem(List=division, Index=0, Wrap=True)
vpoints = PointsToVolume(Points=python_3.vertices, PointRadius=joint_outer_radius_sphere, Settings=vsettings)
vcurve_4 = CurveToVolume(Curves=line_2, CurveRadius=rod_holder_outer_radius_cylinder, Settings=vsettings)
vpoints_2 = PointsToVolume(Points=python_3.vertices, PointRadius=item_2, Settings=vsettings)
vcurve_5 = CurveToVolume(Curves=line, CurveRadius=addition, Settings=vsettings)
vpoints_3 = PointsToVolume(Points=pshift_6, PointRadius=pshift_5, Settings=vsettings)
number_slider_2 = Slider(1, range=1..5)
amp = Amplitude(Vector=deplane.XAxis, Amplitude=expr("-x", rod_holder_outer_radius_cylinder))
amp_2 = Amplitude(Vector=deplane.YAxis, Amplitude=expr("-x", rod_holder_outer_radius_cylinder))
sph_3 = Sphere(Base=python_3.vertices, Radius=item_3)
amp_3 = Amplitude(Vector=deplane.XAxis, Amplitude=rod_holder_outer_radius_cylinder)
amp_4 = Amplitude(Vector=deplane.YAxis, Amplitude=rod_holder_outer_radius_cylinder)
ln_3 = Line(StartPoint=python_3.vertices, EndPoint=popgeo)
pl_2 = PlaneNormal(Origin=popgeo, ZAxis=ln_3)
srf_3 = Surface(sph_3)
move = Move(Geometry=deplane.Origin, Motion=amp_3)  # -> Geometry, Transform
move_2 = Move(Geometry=deplane.Origin, Motion=amp_4)  # -> Geometry, Transform
move_3 = Move(Geometry=deplane.Origin, Motion=amp)  # -> Geometry, Transform
move_4 = Move(Geometry=deplane.Origin, Motion=amp_2)  # -> Geometry, Transform
vint = VolumeIntersection(VolumeA=vpoints, VolumesB=vcurve_2)
vint_2 = VolumeIntersection(VolumeA=vpoints, VolumesB=vcurve_4)
dom_2 = ConstructDomain(DomainStart=expr("-x", labeling_pattern_multiplication), DomainEnd=labeling_pattern_multiplication)
xy = XYPlane(Origin=Point(0, 0, 0))
pl_origin_2 = PlaneOrigin(Base=pl_2, Origin=python_3.vertices)
lng_3 = ListLength(List=flatten(python_3.vertices))
ln_4 = Line(StartPoint=move_2.Geometry, EndPoint=move_4.Geometry)
scx_2 = SurfaceCurve(Surface=srf_3, Curve=ln_3)  # -> Curves, Points, UVPoints, Normals, Parameters, Tangents
ln_5 = Line(StartPoint=move.Geometry, EndPoint=move_3.Geometry)
div = DivideDomain(Domain=dom_2, Count=number_slider_2)
planesrf = PlaneSurface(Plane=xy, XSize=dom_2, YSize=dom_2)
crossref = CrossReference(ListA=div, ListB=div, CrossMode=1)  # -> ListA, ListB
rotate = Rotate(Geometry=ln_5, Angle=2.073451151, Plane=pl)  # -> Geometry, Transform
rotate_2 = Rotate(Geometry=ln_5, Angle=1.036725576, Plane=pl)  # -> Geometry, Transform
series = Series(Start=0, Step=1, Count=lng_3)
pl_3 = PlaneNormal(Origin=scx_2.Points, ZAxis=scx_2.Normals)
amp_5 = Amplitude(Vector=scx_2.Normals, Amplitude=Slider(2, range=0..10))
vunion = VolumeUnion(Volumes=[vint_2, vpoints_2, vint, vcurve])
qsph = QuadSphere(Base=pl_origin_2, Radius=item_2)
dom² = ConstructDomain²(DomainU=crossref.ListA, DomainV=crossref.ListB)
merge_2 = Merge(Data1=ln_5, Data2=rotate_2.Geometry, Data4=rotate.Geometry)
move_5 = Move(Geometry=pl_3, Motion=expr("-x", amp_5))  # -> Geometry, Transform
debrep = DeconstructBrep(Brep=qsph)  # -> Faces, Edges, Vertices
vsmooth = SmoothVolume(Volume=vunion, Width=Slider(0.4, range=0..10), Type=2, Iterations=1)
subsrf = Isotrim(Surface=planesrf, Domain=dom²)
pshift_7 = ShiftPaths(Data=series, Offset=-1)  # -> simplify(graft(Data))
vcurve_6 = CurveToVolume(Curves=merge_2, CurveRadius=Slider(0.6, range=0..1), Settings=vsettings)
vunion_2 = VolumeUnion(Volumes=[vcurve_5, vpoints_3, vcurve_6])
area = Area(Geometry=subsrf)  # -> Area, Centroid
debrep_2 = DeconstructBrep(Brep=planesrf)  # -> Faces, Edges, Vertices
eval_3 = EvaluateCurve(Curve=reparameterize(debrep_2.Edges), Parameter=0.5)  # -> Point, Tangent, Angle
text = DefineTextObject(Text=pshift_7, Plane=move_5.Geometry, DimensionStyle="Default02", OutputType="Curve")
scale = Scale(Geometry=text, Center=move_5.Geometry, Factor=Slider(5, range=0..10))  # -> simplify(Geometry), Transform
area_2 = Area(Geometry=debrep_2.Faces)  # -> Area, Centroid
item_4 = ListItem(List=debrep_2.Vertices, Index=0, Wrap=True)
item_5 = ListItem(List=debrep_2.Vertices, Index=1, Wrap=True)
item_6 = ListItem(List=debrep_2.Vertices, Index=2, Wrap=True)
item_7 = ListItem(List=debrep_2.Vertices, Index=3, Wrap=True)
item_8 = ListItem(List=eval_3.Point, Index=0, Wrap=True)
item_9 = ListItem(List=eval_3.Point, Index=1, Wrap=True)
item_10 = ListItem(List=eval_3.Point, Index=2, Wrap=True)
item_11 = ListItem(List=eval_3.Point, Index=3, Wrap=True)
project = Project(Curve=scale.Geometry, Brep=srf_3, Direction=scx_2.Normals)  # -> simplify(Curve)
ln_6 = Line(StartPoint=item_10, EndPoint=item_11)
ln_7 = Line(StartPoint=item_10, EndPoint=item_9)
pshift_8 = ShiftPaths(Data=project, Offset=-1)
eval_4 = EvaluateCurve(Curve=reparameterize(ln_6), Parameter=0.5)  # -> Point, Tangent, Angle
eval_5 = EvaluateCurve(Curve=reparameterize(ln_7), Parameter=0.5)  # -> Point, Tangent, Angle
ln_8 = Line(StartPoint=area_2.Centroid, EndPoint=item_11)
ln_9 = Line(StartPoint=area_2.Centroid, EndPoint=item_4)
ln_10 = Line(StartPoint=area_2.Centroid, EndPoint=item_8)
ln_11 = Line(StartPoint=area_2.Centroid, EndPoint=item_5)
ln_12 = Line(StartPoint=area_2.Centroid, EndPoint=item_9)
ln_13 = Line(StartPoint=area_2.Centroid, EndPoint=item_6)
ln_14 = Line(StartPoint=area_2.Centroid, EndPoint=item_10)
vcurve_7 = CurveToVolume(Curves=pshift_8, CurveRadius=Slider(0.9, range=0..1), Settings=vsettings)
ln_15 = Line(StartPoint=eval_4.Point, EndPoint=eval_5.Point)
line_4 = Line(flatten([debrep_2.Edges, ln_6, ln_15]))
python_5 = GhPythonScript(number=series, base=flatten(line_4), l0=ln_8, l1=ln_9, l2=ln_10, l3=ln_11, l4=ln_12, l5=ln_13, l6=ln_14)  # -> out, numbering_pattern, lines; inputs number: Int32, base: list of Line, l0: Line, l1: Line, l2: Line, l3: Line, l4: Line, l5: Line, l6: Line
# ---------- python_5: Python ----------
__author__ = "nico"
__version__ = "2018.12.11"

import rhinoscriptsyntax as rs
import Rhino.Geometry as rg

num = "{0:07b}".format(number)
numbering_pattern = []


#create a list of lines for the binary representation
lines = []
lines.append(l6)
lines.append(l5)
lines.append(l4)
lines.append(l3)
lines.append(l2)
lines.append(l1)
lines.append(l0)

print num
#create pattern
temp_pat = []
for i, char in enumerate(num):
    print char
    if int(char) == 1:
        print i
        numbering_pattern.append(lines[i])
        
print temp_pat
for i in base:
    numbering_pattern.append(i)


#numbering_pattern.append(temp_pat)
# ---------- end python_5 ----------
division_2 = Division(A=1, B=number_slider_2)
vec2pt = Vector2Pt(PointA=xy, PointB=area.Centroid, Unitize=False)  # -> Vector, Length
geo_2 = Geometry(simplify(python_5.numbering_pattern))
geo_3 = Geometry(python_5.lines)
textdot = DefineTextDot(Text=graft(series), Location=python_3.vertices, Font="Arial", Size=20)  # -> simplify(TextDot)
tag = TextTag(Location=python_3.vertices, Text=graft(series))
panel_5 = Panel("C:\Users\nico\Documents\ETH\Semester1\W47_51\exercice\joint_connector_generalized\181212_tabe\joints\")
reb = RebuildCurve(Curve=geo_2, Count=10, Tangents=False)
scale_2 = Scale(Geometry=reb, Center=xy, Factor=division_2)  # -> graft(Geometry), Transform
button = Button()
move_6 = Move(Geometry=scale_2.Geometry, Motion=vec2pt.Vector)  # -> Geometry, Transform
geo_4 = Geometry(simplify(graft(debrep.Faces)))
export = ExportObjects(FolderPath=panel_5, FileName=simplify(graft(series)), FileExtension=".3dm", AxisSystem=PlaneXY(0, 0, 0), Export=button)
pshift_9 = ShiftPaths(Data=move_6.Geometry, Offset=-1)
python_6 = GhPythonScript(x=pshift_9)  # -> out, tree; inputs x: tree of Curve
# ---------- python_6: Python ----------
__author__ = "ytakzk"
__version__ = "2018.12.11"

import rhinoscriptsyntax as rs

import clr
clr.AddReference("Grasshopper")
import Grasshopper.Kernel.Data.GH_Path as ghpath
import Grasshopper.DataTree as datatree
import System
 
tree = datatree[System.Object]()

for i, values in enumerate(x.Branches):
    
    for j in range(6):
        path = ghpath(i, j)
        
        for v in values:
            tree.Add(v, path)
# ---------- end python_6 ----------
label_engraving_height = Slider(0.6, range=0..1)
map_srf = MapToSurface(Curve=python_6.tree, Source=planesrf, Target=geo_4)
pshift_10 = ShiftPaths(Data=map_srf, Offset=-1)
vcurve_8 = CurveToVolume(Curves=pshift_10, CurveRadius=label_engraving_height, Settings=vsettings)
volume = Volume(simplify(vcurve_8))
vunion_3 = VolumeUnion(Volumes=[vcurve_7, vsmooth, volume])
vdiff = VolumeDifference(VolumeA=vunion_3, VolumesB=vunion_2)
vsmooth_2 = SmoothVolume(Volume=vdiff, Width=Slider(0.1, range=0..10), Type=2, Iterations=1)
mvolume = VolumeToMesh(Volume=vsmooth_2, VolumeSettings=vsettings)
clean = CombineClean(Meshes=mvolume)
wblaplace = WeaverbirdsLaplacianSmoothing(MeshCurves=clean, Level=1, SmoothNakedEdges=1, Thin=1)  # -> simplify(OutputMeshCurves)
bake = BakeObjects(Geometry=[wblaplace, textdot], BakeName="joints", Bake=button, groupObject=True)
panel_6 = Panel(bake)
