# Grasshopper definition workflow.gh (Grasshopper 1.0.4)
# plug-ins: LunchBox, Kangaroo2 Components

python = GhPythonScript()  # -> out, cd
# ---------- python: Python ----------
__author__ = "ytakzk"
__version__ = "2018.12.04"

path = ghenv.Component.OnPingDocument().FilePath

separator = '/'
split = path.split(separator)

if len(split) < 2:
    separator = '\\'
    split = path.split(separator)

cd = separator.join(split[:-1]) + separator
# ---------- end python ----------
panel = Panel(python.cd)
# Run a Server
python_2 = GhPythonScript(python="C:\tools\Anaconda2\envs\python36\python.exe", cd=python.cd, port="9999", run=Toggle(True))  # -> out, s; inputs port: Int32, run: Boolean
# ---------- python_2: Python ----------
__author__ = "ytakzk"
__version__ = "2018.12.04"

import os
import threading
import time
import socket

TCP_IP   = '127.0.0.1'

def establish_server():
        
    command = 'cd %s && %s app.py -port %d' % (cd, python, port) 
    print(command)
    os.system(command)
    
if run:
    print('Run a server')
    t = threading.Thread(target=establish_server)
    t.start()
    
    time.sleep(2)
    
    s = socket.socket(socket.AF_INET, socket.SOCK_STREAM)
    s.connect((TCP_IP, port))
    s.settimeout(0.01)
# ---------- end python_2 ----------
# Model Selecion
python_3 = GhPythonScript(s=python_2.s, index=Slider(10, range=0..8400))  # -> out, succeeded; inputs index: Int32
# ---------- python_3: Python ----------
__author__ = "ytakzk"
__version__ = "2018.12.05"

import time
import socket

succeeded = False
if s:

    message = 'fetch_data__%d' % index
    s.send(message)
    
    i = 0
    while i < 300:
        try:
            data = s.recv(1024)
            
            if data == message:
                succeeded = True
                break
                
        except socket.timeout:
            pass
        i += 1
# ---------- end python_3 ----------
# Close Connection
python_4 = GhPythonScript(s=python_2.s, run=Button())  # -> out, a; inputs run: Boolean
# ---------- python_4: Python ----------
__author__ = "ytakzk"
__version__ = "2018.12.05"

if s and run:
    s.send('close__')
# ---------- end python_4 ----------
merge = Merge(
    Data1=Slider(0, range=-1..1),
    Data2=Slider(0, range=-1..1),
    Data3=Slider(-0.4, range=-1..1),
    Data4=Slider(0, range=-1..1),
    Data5=Slider(0, range=-1..1),
    Data6=Slider(-0.4, range=-1..1),
    Data7=Slider(1, range=-1..1),
    Data8=Slider(0.2, range=-1..1))
panel_2 = Panel(python_2.out)
panel_3 = Panel(python_2.s)
# Manipulation
python_5 = GhPythonScript(s=python_2.s, succeeded=python_3.succeeded, diff_list=merge)  # -> out, succeeded; inputs succeeded: Boolean, diff_list: list
# ---------- python_5: Python ----------
__author__ = "ytakzk"
__version__ = "2018.12.05"

import socket

if s and succeeded:
    
    diff_str = ''
    for i, diff in enumerate(diff_list):
        diff_str += '%d:%.6f,' % (i, diff)
    diff_str = diff_str[:-1]

    message = 'manipulate__%s' % diff_str
    s.send(message)
    
    i = 0
    while i < 200:
        try:
            data = s.recv(1024)
            
            if data == message:
                succeeded = True
                print('succeeded')
                break
                
        except socket.timeout:
            pass
        i += 1
# ---------- end python_5 ----------
# Pointcloud Generation
python_6 = GhPythonScript(s=python_2.s, succeeded=python_5.succeeded)  # -> out, succeeded; inputs succeeded: Boolean
# ---------- python_6: Python ----------
__author__ = "ytakzk"
__version__ = "2018.12.05"

import socket

if s and succeeded:
    
    message = 'generate_pointcloud__' 
    s.send(message)
    
    i = 0
    while i < 200:
        try:
            data = s.recv(1024)
            
            if data == message:
                succeeded = True
                print('succeeded')
                break
                
        except socket.timeout:
            pass
        i += 1
# ---------- end python_6 ----------
# Pointcloud to Mesh
python_7 = GhPythonScript(s=python_2.s, alpha=Slider(0.03, range=0..0.1))  # -> out, succeeded; inputs succeeded: Boolean
# ---------- python_7: Python ----------
__author__ = "ytakzk"
__version__ = "2018.12.05"

import socket

if s and succeeded:
    
    message = 'generate_mesh__%.2f' % alpha 
    s.send(message)
    
    i = 0
    while i < 200:
        try:
            data = s.recv(1024)
            
            if data == message:
                succeeded = True
                print('succeeded')
                break
                
        except socket.timeout:
            pass
        i += 1
# ---------- end python_7 ----------
# Pointcloud Visualization
python_8 = GhPythonScript(cd=python.cd, succeeded=python_6.succeeded)  # -> out, point_cloud; inputs succeeded: Boolean
# ---------- python_8: Python ----------
__author__ = "ytakzk"
__version__ = "2018.12.07"

import Rhino.Geometry as rg

file_name = cd + 'pointcloud2mesh/mount/point_cloud.txt'

if succeeded:

    point_cloud = []
    with open(file_name, 'rb') as file:

        lines = file.read().split('\n')[1:]
        
        for l in lines:
            
            vals = l.split(' ')
            
            if not len(vals) == 3:
                continue
            
            x = float(vals[0])
            y = float(vals[1])
            z = float(vals[2])
            
            p = rg.Point3d(x, y, z)
            point_cloud.append(p)
# ---------- end python_8 ----------
# Mesh Visualization
mesh_visualization = GhPythonScript(cd=python.cd, succeeded=python_7.succeeded)  # -> mesh; inputs succeeded: Boolean
# ---------- mesh_visualization: Python ----------
__author__ = "ytakzk"
__version__ = "2018.12.04"

import rhinoscriptsyntax as rs
import Rhino.Geometry as rg

if succeeded:

    path = cd + '/pointcloud2mesh/mount/output.off'

    with open(path, 'r') as file:
        
        vertices = []
        faces = []
        
        for i, l in enumerate(file):
            
            if i < 2:
                continue
                
            vals = l.split(' ')
            
            if len(vals) == 3:
                vals = [float(v) for v in vals]
                vertices.append(vals)
            elif len(vals) == 4:
                vals = [int(v) for v in vals[1:]]
                faces.append(vals)
                
        mesh = rs.AddMesh(vertices, faces)
# ---------- end mesh_visualization ----------
weld = WeldMesh(Mesh=mesh_visualization, Angle=3.141592654)
mesh = Mesh(weld)
unim = UnifyMesh(Mesh=mesh)  # -> Result, Count
clean = CombineClean(Meshes=unim.Result)
bbox = BoundingBox(Content=clean, Plane=PlaneXY(0, 0, 0))  # -> Box, Box_2
debox = DeconstructBox(Box=bbox.Box)  # -> Plane, X, Y, Z
dedomain = DeconstructDomain(Domain=debox.Z)  # -> Start, End
subtraction = Subtraction(A=dedomain.End, B=dedomain.Start)
division = Division(A=Slider(450, range=300..800), B=subtraction)
scale = Scale(Geometry=clean, Center=Point(0, 0, 0), Factor=division)  # -> Geometry, Transform
mesh_2 = Mesh(scale.Geometry)
python_9 = GhPythonScript(m=mesh_2, length=Slider(180, range=0..1000))  # -> out, decimated_mesh; inputs m: Mesh
# ---------- python_9: Python ----------
__author__ = "ytakzk"
__version__ = "2018.12.07"

import Rhino.Geometry as rg

res = m.CollapseFacesByEdgeLength(False, length)
print res, 'edges are decimated.'

decimated_mesh = m
# ---------- end python_9 ----------
clean_2 = CombineClean(Meshes=python_9.decimated_mesh)
panel_4 = Panel(python_9.out)
mshreduce = MeshReduce(TargetSize=Slider(400, range=0..1000), Distort=Toggle(True), Accuracy=Slider(5, range=0..10), NormalizeSize=Toggle(True))

# ---- group: total length of rods
mesh_3 = Mesh(clean_2)
medges = MeshEdges(Mesh=mesh_3)  # -> NakedEdges, InteriorEdges, NonManifoldEdges
merge_2 = Merge(Data1=medges.NakedEdges, Data2=medges.InteriorEdges, Data3=medges.NonManifoldEdges)
len = Length(Curve=merge_2)
ma = MassAddition(Input=len)  # -> Result, PartialResults

# ----
python_10 = GhPythonScript()  # -> out, pairs, vertices; inputs m: Mesh
# ---------- python_10: Python ----------
__author__ = "ytakzk"
__version__ = "2018.12.06"

import Rhino.Geometry as rg
import clr
clr.AddReference("Grasshopper")
import Grasshopper.Kernel.Data.GH_Path as ghpath
import Grasshopper.DataTree as datatree
import System

pairs = datatree[System.Object]()
vertices = datatree[System.Object]()

for i, v in enumerate(m.TopologyVertices):
    
    induces = m.TopologyVertices.ConnectedTopologyVertices(i)

    path = ghpath(i)

    for v in induces:
        vertex = m.TopologyVertices[v]
        pairs.Add(vertex, path)
    
    vertices.Add(m.TopologyVertices[i], path)
# ---------- end python_10 ----------
demesh = DeconstructMesh()  # -> Vertices, Faces, Colours, Normals
medges_2 = MeshEdges()  # -> NakedEdges, InteriorEdges, NonManifoldEdges
lng = ListLength(List=demesh.Vertices)
preview = CustomPreview(Geometry=mshreduce, Material=ColourSwatch(SwatchColor=RGBA(36, 255, 167, 69)))
merge_3 = Merge(Data1=medges_2.NakedEdges, Data2=medges_2.InteriorEdges, Data3=medges_2.NonManifoldEdges)
panel_5 = Panel(python_10.pairs)
panel_6 = Panel(lng)
lng_2 = ListLength(List=merge_3)
len_2 = Length(Curve=merge_3)
panel_7 = Panel(ma.Result)
panel_8 = Panel(lng_2)
bar_graph = BarGraph(len_2, BarColor=RGB(255, 0, 90))
sort = SortList(Keys=len_2, ValuesA=merge_3)  # -> Keys, ValuesA
division_2 = Division(A=ma.Result, B="1000")
panel_9 = Panel(python_10.vertices)
item = ListItem(List=sort.ValuesA, Index="-1", Wrap=True)
item_2 = ListItem(List=sort.ValuesA, Index=0, Wrap=True)
panel_10 = Panel(sort.ValuesA)
ma_2 = MassAddition(Input=len_2)  # -> Result, PartialResults
panel_11 = Panel(ma_2.Result)
